# Grasshopper definition MocapDemo.gh (Grasshopper 0.9.76)
# plug-ins: Python Interpreter

timer = Timer(TimerInterval=20, Target=python)  # disabled
# Mocap Stream Receiver
toggle = BooleanToggle(False)
python = PythonScript(reset=toggle, version="2900")  # -> out, received, position, orient, xaxis, yaxis; inputs reset: Boolean
# ---------- python: Python ----------
# Demonstration of receiving and parsing an Optitrack motion capture real-time stream.
# This is normally polled from a timer.
#
# inputs
#   reset   - Boolean flag to reset the receiver system
#   version - string defining the protocol version number (e.g. "2900" for Motive 1.9)
#
# outputs
#   out      - debugging text stream
#   received - flag true if new data was received
#   position - data tree of position tuples
#   orient   - data tree of quaternion tuples, orientations are (x,y,z,w) quaternions
#   xaxis    - data tree of X axis unit vectors (computed from orientations)
#   yaxis    - data tree of Y axis unit vectors (computed from orientations)

# use persistent state context
import scriptcontext

# import the Optitrack stream receiver
import optirecv

# If the user reset input is set, then clear any existing state and do nothing.
if reset:
    print "Resetting receiver state."
    scriptcontext.sticky['mocap_port'] = None
 
else:
   # fetch or create the persistent motion capture streaming receiver port
    port = scriptcontext.sticky.get('mocap_port')
    if port is None:
        port = optirecv.OptitrackReceiver(version)
        scriptcontext.sticky['mocap_port'] = port
    
    received = True
    while received:
        received = port.poll()
        
    # always set the output variables so the most recent values are available
    position, orient, xaxis, yaxis = port.make_data_trees()
# ---------- end python ----------

# ----
# Mocap CSV File Loader
# Note: the Mocap CSV loader rotates
# the input data from the XZ ground plane
# convention of the Optitrack system
# to a XY Rhino ground plane convention.
# Length of axes
path = FilePath("C:\Users\garthz\Rhino\HMV-S16\MocapDemo\Take 2016-01-19 12.25.04 AM.csv")
panel = Panel(path)
python_2 = PythonScript(path=panel)  # -> out, names, position, xaxis, yaxis
# ---------- python_2: Python ----------
# demo_reader.py - the file loader script in the ghpython object in MocapDemo.gh.

# Demonstration of parsing an Optitrack motion capture CSV file.
#
# inputs
#   path    - string with the full path to the CSV file
#
# outputs
#   out      - debugging text stream
#   names    - data tree of body names
#   position - data tree of position tuples
#   xaxis    - data tree of X axis unit vectors (computed from orientations)
#   yaxis    - data tree of Y axis unit vectors (computed from orientations)


# import the Optitrack file loader from the same folder
import optiload

# load the file
take = optiload.load_csv_file(path)

print "Found rigid bodies:", take.rigid_bodies.keys()

# emit all return values
names = take.rigid_bodies.keys()
position, xaxis, yaxis = optiload.make_data_trees(take)
# ---------- end python_2 ----------
number_slider = Slider(0.2, range=0..1)
panel_2 = Panel(python_2.out)
panel_3 = Panel(python_2.names)
panel_4 = Panel(python_2.yaxis)
panel_5 = Panel(python_2.xaxis)
multiplication = Multiplication(A=python_2.xaxis, B=number_slider)
multiplication_2 = Multiplication(A=python_2.yaxis, B=number_slider)
panel_6 = Panel(python_2.position)
addition = Addition(A=python_2.position, B=multiplication_2)
addition_2 = Addition(A=python_2.position, B=multiplication)
pt = Point(python_2.position)
ln = Line(StartPoint=pt, EndPoint=addition_2)
ln_2 = Line(StartPoint=pt, EndPoint=addition)

panel_7 = Panel(python.out)
panel_8 = Panel(python.received)
pt2num = NumbersToPoints(Numbers=python.position, Mask=4)
# Reconstruct object Planes
# from the origin and basis vectors.
# 
# The stream includes an origin and
# quaternion for each rigid body.
pt2num_2 = NumbersToPoints(Numbers=python.yaxis, Mask=4)
pt2num_3 = NumbersToPoints(Numbers=python.xaxis, Mask=4)
bool = Boolean(python.received)
pt_2 = Point(pt2num)
pt_3 = Point(pt2num_2)
pt_4 = Point(pt2num_3)
addition_3 = Addition(A=pt_2, B=pt_4)
addition_4 = Addition(A=pt_2, B=pt_3)
panel_9 = Panel(python.position)
pl_3pt = Plane3Pt(PointA=pt_2, PointB=addition_3, PointC=addition_4)
pline = PolyLine(Vertices=[pt_2, addition_3, addition_4], Closed=False)
rec = DataRecorder(pline, DataLimit=-10, RecordData=False)
crv = Curve(rec)
panel_10 = Panel(crv)
